# Grasshopper definition test_revit_create_familyInstance.gh (Grasshopper 1.0.7)
# plug-ins: Bifocals

gallery = ImageGallery(CycleDelay=30, Randomize=False, UseLocalImages=True, UseRemoteImages=True)
# Get Symbol in GHpython
python = GhPythonScript()  # -> out, a
# ---------- python: Python ----------
import clr
clr.AddReference('RevitAPI')

from Autodesk.Revit.DB import BuiltInCategory,FilteredElementCollector,FamilySymbol,BuiltInParameter
from revit.rhinoinside_utils import get_active_doc


def get_built_in_category(category_name):
    try:
        # 文字列からBuiltInCategoryを取得
        category = getattr(BuiltInCategory, category_name)
        return category
    except Exception as e:
        # カテゴリが見つからない場合はNoneを返す
        return None
        
def query_family_type(doc, category, type_name):
    # 指定されたカテゴリとタイプ名に基づいてFamily Typeを取得
    collector = FilteredElementCollector(doc).OfClass(FamilySymbol).OfCategory(category)
    for elem in collector:
        if elem.get_Parameter(BuiltInParameter.ALL_MODEL_TYPE_NAME).AsString() == type_name:
            return elem
    return None
    
# 使用例
category_name = 'OST_Furniture'
category = get_built_in_category(category_name)

doc = get_active_doc()
print(query_family_type(doc,category,'GEL-Chair-一般オフィスチェア'))
# ---------- end python ----------
# Write From Library
panel = Panel("Desk")
pt = Point(<point referenced from the Rhino model>)
pt_2 = Point(<point referenced from the Rhino model>)
python_2 = GhPythonScript()  # -> out, a
# ---------- python_2: Python ----------
from revit.rhinoinside_utils import get_active_doc

a = get_active_doc()
# ---------- end python_2 ----------
python_3 = GhPythonScript()  # -> out, a
# ---------- python_3: Python ----------
import clr
clr.AddReference('RhinoInside.Revit')
clr.AddReference('System.Core')
clr.AddReference('RevitAPI') 
clr.AddReference('RevitAPIUI')
from RhinoInside.Revit import Revit, Convert
from Autodesk.Revit import DB
from System.Collections.Generic import List, IList
from System import Enum, Action, Func, Uri, Guid, DateTime
from Autodesk.Revit.DB import XYZ, Line as RevitLine, CurveArray, CurveArrArray,NurbSpline,BoundingBoxXYZ, Arc as RevitArc,Curve as RevitCurve,CurveLoop,CylindricalHelix, Ellipse as RevitEllipse,HermiteSpline 
from Rhino.Geometry import Arc, Circle,Point3d,Point3f, Vector3d,Vector3f,Line ,Polyline, PolyCurve, Curve, PolylineCurve, NurbsCurve,LineCurve,Ellipse,Arc,Circle,ArcCurve
import RhinoInside.Revit.Convert.Geometry
clr.ImportExtensions(RhinoInside.Revit.Convert.Geometry)



def get_active_doc():
    return Revit.ActiveDBDocument

def get_active_ui_doc():
    return Revit.ActiveUIDocument

def convert_rhino_to_revit_length(rhino_length):
    return Convert.Geometry.GeometryEncoder.ToInternalLength(rhino_length)

def convert_revit_to_rhino_length(revit_length):
    return Convert.Geometry.GeometryDecoder.ToModelLength(revit_length)

def convert_rhino_to_revit_geometry(rhino_geometry):
    geometry_type = type(rhino_geometry)
    print(geometry_type)
    if geometry_type is Point3d or \
        geometry_type is Point3f or \
        geometry_type is Vector3d or \
        geometry_type is Vector3f:
            return rhino_geometry.ToXYZ()
    elif geometry_type is Ellipse or \
        geometry_type is LineCurve or \
        geometry_type is NurbsCurve or \
        geometry_type is PolyCurve or \
        geometry_type is PolylineCurve or \
        geometry_type is Curve or \
        geometry_type is ArcCurve:
            return rhino_geometry.ToCurve()
    elif geometry_type is Polyline:
        return rhino_geometry.ToPolyLine()
    elif geometry_type is Line:
        return rhino_geometry.ToLine()
    elif geometry_type is Arc or\
        geometry_type is Circle:
            return rhino_geometry.ToArc()
    else:
        raise ValueError("Unsupported geometry type: {0}".format(geometry_type))
def convert_revit_to_rhino_geometry(revit_geometry):
    geometry_type = type(revit_geometry)
    print(geometry_type)
    if geometry_type is BoundingBoxXYZ:
            return revit_geometry.ToBox()
    elif geometry_type is RevitArc or \
        geometry_type is RevitCurve or \
        geometry_type is CurveLoop or \
        geometry_type is RevitLine or \
        geometry_type is CylindricalHelix or \
        geometry_type is NurbSpline or \
        geometry_type is HermiteSpline:
            return revit_geometry.ToCurve()
    elif geometry_type is CurveArray or \
        geometry_type is CurveArrArray:
            return revit_geometry.ToCurveMany()
    elif geometry_type is XYZ:
            return revit_geometry.ToPoint3d()
    else:
        raise ValueError("Unsupported geometry type: {0}".format(geometry_type))
        
     
a = get_active_doc()
# ---------- end python_3 ----------
panel_2 = Panel(python_3.a)
python_4 = GhPythonScript(point=pt_2, blockname="Desk", bake=Toggle(False))  # -> out, a; inputs point: Point3d, bake: Boolean
# ---------- python_4: Python ----------
from revit.create_familyInstance import place_family_instance_by_name
if _bake:
    familyInstance = place_family_instance_by_name(_blockname, _point)
# ---------- end python_4 ----------
panel_3 = Panel(python_2.a)
python_5 = GhPythonScript(point=pt, blockname=panel)  # -> out, a; inputs point: Point3d
# ---------- python_5: Python ----------
import clr
clr.AddReference('RevitAPI')
from Autodesk.Revit.DB.Structure import StructuralType
from Autodesk.Revit.DB import BuiltInCategory,FilteredElementCollector,FamilySymbol,BuiltInParameter,XYZ,Transaction
from revit.rhinoinside_utils import get_active_doc
from repository.data_processor import find_row_by_name
from revit.rhinoinside_utils import get_active_doc, convert_rhino_to_revit_geometry

def get_built_in_category(category_name):
    try:
        # 文字列からBuiltInCategoryを取得
        category = getattr(BuiltInCategory, category_name)
        return category
    except Exception as e:
        # カテゴリが見つからない場合はNoneを返す
        return None
        
def query_family_symbol(doc, category, type_name):
    # 指定されたカテゴリとタイプ名に基づいてFamily Typeを取得
    collector = FilteredElementCollector(doc).OfClass(FamilySymbol).OfCategory(category)
    for elem in collector:
        if elem.get_Parameter(BuiltInParameter.ALL_MODEL_TYPE_NAME).AsString() == type_name:
            return elem
    return None
    
def place_family_instance(doc, family_symbol, position):
    # FamilyInstanceを配置するためのトランザクションを開始
    transaction = Transaction(doc, "Place Family Instance")
    transaction.Start()

    try:
        # FamilyInstanceを配置
        instance = doc.Create.NewFamilyInstance(position, family_symbol, StructuralType.NonStructural)
        transaction.Commit()
        return instance
    except Exception as e:
        print(e)
        transaction.RollBack()
        return None
        

famiytypename = find_row_by_name(_blockname,'BlockName')[0]['FamilyType']
category_name = find_row_by_name(_blockname,'BlockName')[0]['BuiltInCategory']
print(famiytypename)
print(category_name)

category = get_built_in_category(category_name)
doc = get_active_doc()

family_symbol = query_family_symbol(doc,category,famiytypename)
print(family_symbol.get_Parameter(BuiltInParameter.ALL_MODEL_TYPE_NAME).AsString())
position = convert_rhino_to_revit_geometry(_point)
desk = place_family_instance(doc, family_symbol, position)

print(desk)
# ---------- end python_5 ----------
pt_3 = Point(<point referenced from the Rhino model>)
pt_4 = Point(<point referenced from the Rhino model>)
python_6 = GhPythonScript(x=pt_3)  # -> out, a; inputs x: Point3d
# ---------- python_6: Python ----------
import clr
clr.AddReference('RhinoInside.Revit')
clr.AddReference('System.Core')
clr.AddReference('RevitAPI') 
clr.AddReference('RevitAPIUI')
from RhinoInside.Revit import Revit, Convert
from Autodesk.Revit import DB
from System.Collections.Generic import List, IList
from System import Enum, Action, Func, Uri, Guid, DateTime
from Autodesk.Revit.DB import XYZ, Line as RevitLine, CurveArray, CurveArrArray,NurbSpline,BoundingBoxXYZ, Arc as RevitArc,Curve as RevitCurve,CurveLoop,CylindricalHelix, Ellipse as RevitEllipse,HermiteSpline 
from Rhino.Geometry import Arc, Circle,Point3d,Point3f, Vector3d,Vector3f,Line ,Polyline, PolyCurve, Curve, PolylineCurve, NurbsCurve,LineCurve,Ellipse,Arc,Circle,ArcCurve
import RhinoInside.Revit.Convert.Geometry
clr.ImportExtensions(RhinoInside.Revit.Convert.Geometry)



def get_active_doc():
    return Revit.ActiveDBDocument

def get_active_ui_doc():
    return Revit.ActiveUIDocument

def convert_rhino_to_revit_length(rhino_length):
    return Convert.Geometry.GeometryEncoder.ToInternalLength(rhino_length)

def convert_revit_to_rhino_length(revit_length):
    return Convert.Geometry.GeometryDecoder.ToModelLength(revit_length)

def convert_rhino_to_revit_geometry(rhino_geometry):
    geometry_type = type(rhino_geometry)
    print(geometry_type)
    if geometry_type is Point3d or \
        geometry_type is Point3f or \
        geometry_type is Vector3d or \
        geometry_type is Vector3f:
            return rhino_geometry.ToXYZ()
    elif geometry_type is Ellipse or \
        geometry_type is LineCurve or \
        geometry_type is NurbsCurve or \
        geometry_type is PolyCurve or \
        geometry_type is PolylineCurve or \
        geometry_type is Curve or \
        geometry_type is ArcCurve:
            return rhino_geometry.ToCurve()
    elif geometry_type is Polyline:
        return rhino_geometry.ToPolyLine()
    elif geometry_type is Line:
        return rhino_geometry.ToLine()
    elif geometry_type is Arc or\
        geometry_type is Circle:
            return rhino_geometry.ToArc()
    else:
        raise ValueError("Unsupported geometry type: {0}".format(geometry_type))
def convert_revit_to_rhino_geometry(revit_geometry):
    geometry_type = type(revit_geometry)
    print(geometry_type)
    if geometry_type is BoundingBoxXYZ:
            return revit_geometry.ToBox()
    elif geometry_type is RevitArc or \
        geometry_type is RevitCurve or \
        geometry_type is CurveLoop or \
        geometry_type is RevitLine or \
        geometry_type is CylindricalHelix or \
        geometry_type is NurbSpline or \
        geometry_type is HermiteSpline:
            return revit_geometry.ToCurve()
    elif geometry_type is CurveArray or \
        geometry_type is CurveArrArray:
            return revit_geometry.ToCurveMany()
    elif geometry_type is XYZ:
            return revit_geometry.ToPoint3d()
    else:
        raise ValueError("Unsupported geometry type: {0}".format(geometry_type))
        
     
a = convert_rhino_to_revit_geometry(x)
# ---------- end python_6 ----------
python_7 = GhPythonScript(x=pt_4)  # -> out, a; inputs x: Point3d
# ---------- python_7: Python ----------
from revit.rhinoinside_utils import convert_rhino_to_revit_geometry

a = convert_rhino_to_revit_geometry(x)
# ---------- end python_7 ----------

# ----
# Color Format
# Input
data = Data(1)
# Method
data_2 = Data(1)
# Output
data_3 = Data(1)
# Display
data_4 = Data(1)
# Unuse
data_5 = Data(1)

panel_4 = Panel(python_6.a)
panel_5 = Panel(python_7.a)
